# Grasshopper definition graph_rebuilder.gh (Grasshopper 0.9.76)
# plug-ins: Python Interpreter

py_curr_dir = PythonScript(in_name="edge_output.txt")  # -> out, gh_file, gh_dir, out_file
# ---------- py_curr_dir: Python ----------
gh_file = ghenv.Component.OnPingDocument().FilePath

gh_l = len( gh_file.split('\\')[-1] )

gh_dir = gh_file[:-gh_l]
print(gh_file, gh_dir)
out_file = gh_dir + in_name
# ---------- end py_curr_dir ----------
current_dir_files = Panel([py_curr_dir.gh_file, py_curr_dir.gh_dir, py_curr_dir.out_file])

file = ReadFile(File=py_curr_dir.out_file, PerLineParse=True)
edge_data = Panel(file)
python = PythonScript(data=file)  # -> out, x1, y1, z1, x2, y2, z2, rad
# ---------- python: Python ----------
d = eval(data)

print(d[4])

x1 = []
y1 = []
z1 = []
x2 = []
y2 = []
z2 = []
rad = []

for n, i in enumerate(d):
    x1.append(i[0][0])
    y1.append(i[0][1])
    z1.append(i[0][2])
    x2.append(i[1][0])
    y2.append(i[1][1])
    z2.append(i[1][2])
    rad.append(i[2])
# ---------- end python ----------
sort = SortList(Keys=python.rad)  # -> Keys, ValuesA
data = Data(graft(python.rad))
lng = ListLength(List=sort.Keys)
panel = Panel(data)
pt = ConstructPoint(XCoordinate=python.x1, YCoordinate=python.y1, ZCoordinate=python.z1)
pt_2 = ConstructPoint(XCoordinate=python.x2, YCoordinate=python.y2, ZCoordinate=python.z2)
item = ListItem(List=sort.Keys, Index=expr("-1", lng), Wrap=True)
item_2 = ListItem(List=sort.Keys, Index=0, Wrap=True)
ln = Line(StartPoint=pt, EndPoint=pt_2)
dom = ConstructDomain(DomainStart=item_2, DomainEnd=item)

# ---- group: Bar Size Record
rec = DataRecorder(panel, DataLimit=-10, RecordData=True)
raidus_record = Panel(rec)
graph = QuickGraph(raidus_record)

# ----
multiplication = Multiplication(A=python.rad, B=Slider(0.25, range=0..1))
remap = RemapNumbers(Value=python.rad, Source=dom, Target=Domain(0, 255))  # -> Mapped, Clipped
rgb = ColourRGB(Alpha=255, Red=remap.Mapped, Green=remap.Mapped, Blue=remap.Mapped)

# ---- group: Pipe Size
pipe_size = QuickGraph(python.rad)
pipe = Pipe(Curve=ln, Radius=multiplication, Caps=0)  # -> flatten(Pipe)
preview = CustomPreview(Geometry=pipe, Shader=rgb)
