# Grasshopper definition 3dm_2_nas.gh (Grasshopper 0.9.76)
# plug-ins: Python Interpreter, HDTReference, LunchBox

dpipeline = DynamicGeometryPipeline(
    LayerFilter="feet",
    TypeFilter="Surface",
    NameFilter="*",
    enableFullPath=False,
    GroupByLayer=False,
    GroupByType=False,
    IncludeHidden=True,
    IncludeLocked=True)
number_slider = Slider(2, range=0..10)
quads = QuadPanels(Surface=dpipeline, UDivisions=number_slider, VDivisions=number_slider)  # -> flatten(Panels)

input_curves = Curve([<curve referenced from the Rhino model> x271])
crv = Curve(input_curves)

panel = Panel("{2910.46,-90.201,3173.76}")
srf = Surface([<surface referenced from the Rhino model> x12])
number_slider_2 = Slider(2, range=0..10)
dpipeline_2 = DynamicGeometryPipeline(
    LayerFilter="rbe_ends",
    TypeFilter="Curve",
    NameFilter="*",
    enableFullPath=False,
    GroupByLayer=False,
    GroupByType=False,
    IncludeHidden=True,
    IncludeLocked=True)
pt = Point("{150.0,-30.0,198.0 }")
geo = Geometry(dpipeline_2)
quads_2 = QuadPanels(Surface=srf, UDivisions=number_slider_2, VDivisions=number_slider_2)  # -> flatten(Panels)
explode = Explode(Curve=geo, Recursive=True)  # -> Segments, Vertices
geo_2 = Geometry(flatten(crv))
edges = BrepEdges(Brep=quads_2)  # -> Naked, Interior, NonManifold
end = EndPoints(Curve=explode.Segments)  # -> Start, End
edges_2 = BrepEdges(Brep=quads)  # -> Naked, Interior, NonManifold
join = JoinCurves(Curves=edges.Naked, Preserve=False)
pt_2 = Point(flatten(end.Start))
join_2 = JoinCurves(Curves=edges_2.Naked, Preserve=False)
preview = CustomPreview(Geometry=[quads, edges_2.Naked], Shader=ColourSwatch(SwatchColor=RGB(240, 240, 240)))
flip = FlipMatrix(Data=end.Start)
explode_2 = Explode(Curve=join_2, Recursive=True)  # -> Segments, Vertices
file = ReadFile(File="C:\test\Nastrynamo\VTF_test\scripts\data\grid_lookup.json", PerLineParse=True)  # disabled
file_2 = ReadFile(File="C:\test\Nastrynamo\VTF_test\scripts\data\grid_hash.json", PerLineParse=True)  # disabled
explode_3 = Explode(Curve=join_2, Recursive=True)  # -> Segments, Vertices
panel_2 = Panel(geo_2)
bang = ExplodeTree(Data=flip)  # -> Branch0, Branch1, Branch2, Branch3, Branch4
panel_3 = Panel(flip)
explode_4 = Explode(Curve=join, Recursive=True)  # -> Segments, Vertices
end_2 = EndPoints(Curve=explode_4.Segments)  # -> Start, End
python = PythonScript(Grid=file_2, Lookup=file)  # -> Out, A; disabled
python_2 = PythonScript(mp=bang.Branch0, s1=bang.Branch1, s2=bang.Branch2, s3=bang.Branch3, s4=bang.Branch4)  # -> out, rbe, rbe_str; inputs mp: list of Point3d, s1: list of Point3d, s2: list of Point3d, s3: list of Point3d, s4: list of Point3d
# ---------- python_2: Python ----------
import json

def pt_string(new_pt):
    x = new_pt.X
    y = new_pt.Y
    z = new_pt.Z
    coord = [round(x,3), round(y,3), round(z,3)] 
#    coord = str(round(x,3)) + str(round(y,3)) + str(round(z,3))
    return coord

print(mp[1].X, pt_string(mp[1]) )

rbe = []

for n, i in enumerate(mp):
    unit = [pt_string(i), pt_string(s1[n]),pt_string(s2[n]),pt_string(s3[n]),pt_string(s4[n]) ]
    rbe.append(unit)
    

rbe_str = json.dumps(rbe, sort_keys=True)
rbe_str = str(rbe_str)
print(rbe_str)
# ---------- end python_2 ----------
end_3 = EndPoints(Curve=geo_2)  # -> Start, End
end_4 = EndPoints(Curve=explode_2.Segments)  # -> Start, End
end_5 = EndPoints(Curve=explode_3.Segments)  # -> Start, End
panel_4 = Panel(file)
pdecon = Deconstruct(Point=end_3.Start)  # -> XComponent, YComponent, ZComponent
pdecon_2 = Deconstruct(Point=end_3.End)  # -> XComponent, YComponent, ZComponent
pt_3 = Point(flatten(end_2.Start))
panel_5 = Panel(end_4.Start)
pt_4 = Point(flatten(end_4.Start))
flip_2 = FlipMatrix(Data=end_4.Start)
panel_6 = Panel(python_2.rbe_str)
cullpt = CullDuplicates(Points=pt_3, Tolerance=Slider(0.001, range=0..0.001), CullMode=3)  # -> Points, Indices, Valence
cullpt_2 = CullDuplicates(Points=pt_4, Tolerance=Slider(0.001, range=0..0.001), CullMode=3)  # -> Points, Indices, Valence
dpipeline_3 = DynamicGeometryPipeline(
    LayerFilter="spc",
    TypeFilter="Point",
    NameFilter="*",
    enableFullPath=False,
    GroupByLayer=False,
    GroupByType=False,
    IncludeHidden=True,
    IncludeLocked=True)
bang_2 = ExplodeTree(Data=flip_2)  # -> _0000, _0100, _0200, _0300
pdecon_3 = Deconstruct(Point=cullpt.Points)  # -> XComponent, YComponent, ZComponent
python_3 = PythonScript(
    sX=pdecon.XComponent,
    sY=pdecon.YComponent,
    sZ=pdecon.ZComponent,
    eX=pdecon_2.XComponent,
    eY=pdecon_2.YComponent,
    eZ=pdecon_2.ZComponent)  # -> out, model; inputs sX: list, sY: list, sZ: list, eX: list, eY: list, eZ: list
# ---------- python_3: Python ----------
import json
#import hashlib

from collections import OrderedDict
lines = []
model = []

for c, i in enumerate(sX):
    unit = {}
    
    
    unit["i"] = c
    
    unit["point1"] = (round(sX[c],3), round(sY[c],3), round(sZ[c],3))
    unit["point2"] = (round(eX[c],3), round(eY[c],3), round(eZ[c],3))
    
    start_pt = [ round(sX[c],3), round(sY[c],3), round(sZ[c],3) ]
    end_pt = [ round(eX[c],3), round(eY[c],3), round(eZ[c],3) ]
    model.append([start_pt, end_pt])

    #unit["rad"] = r[c]
    
    lines.append(unit)


line_str = json.dumps(lines, sort_keys=True)

#print(line_str[:500])    
print(model[:10])
a = str(line_str)

model = str(model)
# ---------- end python_3 ----------
python_4 = PythonScript(
    sX=pdecon.XComponent,
    sY=pdecon.YComponent,
    sZ=pdecon.ZComponent,
    eX=pdecon_2.XComponent,
    eY=pdecon_2.YComponent,
    eZ=pdecon_2.ZComponent)  # -> out, a; inputs sX: list, sY: list, sZ: list, eX: list, eY: list, eZ: list
# ---------- python_4: Python ----------
import json
import hashlib

lines = []

#print hashlib.algorithms

def hashbrown(a):
    
    m = hashlib.sha256()
    m.update(str(a) )
    m.digest()
    h = m.hexdigest()[:8]
    
    return h

for c, i in enumerate(sX):
    unit = {}
    unit["i"] = c
    unit["r"] = 1.0
    unit["point1"] = (round(sX[c],3), round(sY[c],3), round(sZ[c],3))
    unit["point2"] = (round(eX[c],3), round(eY[c],3), round(eZ[c],3))
    
#    p1 = str(round(sX[c],3))+ str(round(sY[c],3))+ str(round(sZ[c],3))
#    p2 = str(round(eX[c],3))+ str(round(eY[c],3))+ str(round(eZ[c],3))
#    unit["hash1"] = hashbrown(p1)
#    unit["hash2"] = hashbrown(p2)
    #unit["rad"] = r[c]
    lines.append(unit)

line_str = json.dumps(lines, sort_keys=True)
a = str(line_str)

print(a[:1000])
# ---------- end python_4 ----------
pdecon_4 = Deconstruct(Point=dpipeline_3)  # -> XComponent, YComponent, ZComponent
clean = CleanTree(RemoveNulls=True, RemoveInvalid=True, RemoveEmpty=False, Tree=cullpt_2.Points)
python_5 = PythonScript(a=bang_2._0000, b=bang_2._0100, c=bang_2._0200, d=bang_2._0300)  # -> out, panel_str; inputs a: list of Point3d, b: list of Point3d, c: list of Point3d, d: list of Point3d
# ---------- python_5: Python ----------
import hashlib
import json
import pprint


def hashbrown(a):
    
    
    m = hashlib.md5()
    m.update(str(a).encode('utf-8') )
    m.digest()
    h = m.hexdigest()[:8]
#    print(a)
#    print(h)
    
    return h

panels = {}

for n,i in enumerate(a):
    unit = {}
    unit["v0"] = (round(a[n].X,3), round(a[n].Y,3), round(a[n].Z,3)) 
    unit["v1"] = (round(b[n].X,3), round(b[n].Y,3), round(b[n].Z,3))
    unit["v2"] = (round(c[n].X,3), round(c[n].Y,3), round(c[n].Z,3))
    unit["v3"] = (round(d[n].X,3), round(d[n].Y,3), round(d[n].Z,3))

    
    panels[n] = unit
    
panel_str = json.dumps(panels, sort_keys=True)
panel_str = str(panel_str)

print(panel_str[:1000])
# ---------- end python_5 ----------
pdecon_5 = Deconstruct(Point=clean)  # -> XComponent, YComponent, ZComponent
python_6 = PythonScript(
    x=pdecon_3.XComponent,
    y=pdecon_3.YComponent,
    z=pdecon_3.ZComponent,
    x1=pdecon_4.XComponent,
    y1=pdecon_4.YComponent,
    z1=pdecon_4.ZComponent)  # -> out, spc, load, sim_pt_str; inputs x: list, y: list, z: list, x1: list, y1: list, z1: list
# ---------- python_6: Python ----------
import json

spc = []
load =[]
for n,i in enumerate(x1):
    unit = ""
    unit = [ 91000000+n, round(x1[n],3),round(y1[n],3), round(z1[n],3) ]
    spc.append(unit)
    
for n,i in enumerate(x):
    unit = ""
    unit = [ 92000000+n, round(x[n],3),round(y[n],3), round(z[n],3)]
    load.append(unit)
    

sim_pt = spc + load

sim_pt_str = json.dumps(sim_pt, sort_keys=True)
sim_pt_str = str(sim_pt_str)
print(sim_pt[:1000])
# ---------- end python_6 ----------
panel_7 = Panel(python_3.out)
panel_8 = Panel(python_4.out)
python_7 = PythonScript(x=pdecon_5.XComponent, y=pdecon_5.YComponent, z=pdecon_5.ZComponent)  # -> out, a; inputs x: list, y: list, z: list
# ---------- python_7: Python ----------
a = []
for n,i in enumerate(x):
    unit = ""
    unit = "{},{},{},{}".format(40000000+n, round(x[n],3),round(y[n],3), round(z[n],3) ) 
    a.append(unit)
# ---------- end python_7 ----------
panel_9 = Panel(python_6.sim_pt_str)
panel_10 = Panel(python_7.a)
panel_11 = Panel(python_5.out)
pt_5 = Point(pt_2)
python_8 = PythonScript(csv=python_7.a)  # -> out, line_str, lookup, coord_list, grid_D; inputs csv: list
# ---------- python_8: Python ----------
import hashlib
import json
a = []
x = []
y = []
z =[]
n = []

#print(hashlib.algorithms)

def hashbrown(a):
    
    m = hashlib.md5()
    m.update(str(a).encode('utf-8') )
    m.digest()
    h = m.hexdigest()[:8]
#    print(a)
#    print(h)
    
    return h
    
data_grid_lookup = {}
grid_D = {}

last = 40000001

def find_grid_hash(point):
    
    x = point[0]
    y = point[1]
    z = point[2]
    id = point[3]
    
    coord = str(round(x,3)) + str(round(y,3)) + str(round(z,3))
    key_H = hashbrown(coord)
    
    grid_D[id] = (x, y, z)
    print("key", key_H)
    
    data_grid_lookup[key_H] = id
    return key_H, id


lines = []
lookup = []
coord_list = grid_D

for c, i in enumerate(csv):
    unit = i.split(",")
    a.append(unit)
    id = str(unit[0])
    x1 = float(unit[1])
    y1 = float(unit[2])
    z1 = float(unit[3])
    
    p1 = (round(x1,3), round(y1,3), round(z1,3), id)
    
    lu = find_grid_hash(p1)
    
    grid_D[id] = [x1,y1,z1]

lookup = json.dumps(data_grid_lookup, sort_keys=True)
lookup = str(data_grid_lookup)

grid_D = json.dumps(grid_D, sort_keys=True)
coord_list = str(grid_D)

print("lookup: ", lookup[:1000])
print("coord list ", coord_list)
# ---------- end python_8 ----------

# ---- group: POINT ALL
pt_6 = Point([cullpt_2.Points, pt_5])
pt_7 = Point(flatten(pt_6))

# ----
python_9 = PythonScript()  # -> out, a; disabled
# ---------- python_9: Python ----------
import subprocess

#subprocess.call('cmd')


output = subprocess.call(["python C:\\Users\\damon\\Documents\\GitHub\\lattice-optimization\\test\\test_simulate.py" ]) 

output = subprocess.check_output(["python", path + "cluster.py", data, str(num_clusters)])
# ---------- end python_9 ----------

panel_12 = Panel("model_T.json")  # disabled
py_curr_dir = PythonScript(in_name=panel_12)  # -> out, gh_file, gh_dir, out_file; disabled
# ---------- py_curr_dir: Python ----------
gh_file = ghenv.Component.OnPingDocument().FilePath

gh_l = len( gh_file.split('\\')[-1] )

gh_dir = gh_file[:-gh_l]
print(gh_file, gh_dir)
out_file = gh_dir + in_name
# ---------- end py_curr_dir ----------
current_dir_files = Panel([py_curr_dir.gh_file, py_curr_dir.gh_dir, py_curr_dir.out_file])  # disabled

panel_13 = Panel("line_ONE.json")  # disabled
py_curr_dir_2 = PythonScript(in_name=panel_13)  # -> out, gh_file, gh_dir, out_file; disabled; same code as py_curr_dir
current_dir_files_2 = Panel([py_curr_dir_2.gh_file, py_curr_dir_2.gh_dir, py_curr_dir_2.out_file])  # disabled

cullpt_3 = CullDuplicates(Points=pt_7, Tolerance=Slider(0.001, range=0..0.001), CullMode=3)  # -> Points, Indices, Valence
pdecon_6 = Deconstruct(Point=cullpt_3.Points)  # -> XComponent, YComponent, ZComponent
python_10 = PythonScript(x=pdecon_6.XComponent, y=pdecon_6.YComponent, z=pdecon_6.ZComponent)  # -> out, a; inputs x: list, y: list, z: list
# ---------- python_10: Python ----------
a = []
for n,i in enumerate(x):
    unit = ""
    unit = "{},{},{},{}".format(20000000+n, round(x[n],3),round(y[n],3), round(z[n],3) ) 
    a.append(unit)
# ---------- end python_10 ----------
python_11 = PythonScript(csv=python_10.a)  # -> out, line_str, lookup, coord_list, grid_D; inputs csv: list
# ---------- python_11: Python ----------
import hashlib
import json
a = []
x = []
y = []
z =[]
n = []

#print(hashlib.algorithms)

def hashbrown(a):
    
    m = hashlib.md5()
    m.update(str(a).encode('utf-8') )
    m.digest()
    h = m.hexdigest()[:8]
#    print(a)
#    print(h)
    
    return h
    
data_grid_lookup = {}
grid_D = {}

last = 20000001

def find_grid_hash(point):
    
    x = point[0]
    y = point[1]
    z = point[2]
    id = point[3]
    
    coord = str(round(x,3)) + str(round(y,3)) + str(round(z,3))
    key_H = hashbrown(coord)
    
    grid_D[id] = (x, y, z)
#    print("key", key_H)
    
    data_grid_lookup[key_H] = [int(id)]
    return key_H, id


lines = []
lookup = []
coord_list = grid_D

for c, i in enumerate(csv):
    unit = i.split(",")
    a.append(unit)
    id = str(unit[0])
    x1 = float(unit[1])
    y1 = float(unit[2])
    z1 = float(unit[3])
    
    p1 = (round(x1,3), round(y1,3), round(z1,3), id)
    
    lu = find_grid_hash(p1)
    
    grid_D[id] = [x1,y1,z1]

lookup = json.dumps(data_grid_lookup, sort_keys=True)
lookup = str(data_grid_lookup)

grid_D = json.dumps(grid_D, sort_keys=True)
coord_list = str(grid_D)

print("lookup: ", lookup[:1000])
#print("coord list ", coord_list)
# ---------- end python_11 ----------

python_12 = PythonScript(path=py_curr_dir.out_file, data=python_3.model)  # -> out, a; disabled
# ---------- python_12: Python ----------
j = ''

#for i in data:
#    csv = csv + '\n' + i
#
#print(csv)

j = data

with open(path, "w") as text_file:
	text_file.write(j)
# ---------- end python_12 ----------

panel_14 = Panel(python_11.coord_list)
panel_15 = Panel(python_11.lookup)

python_13 = PythonScript(path=py_curr_dir_2.out_file, data=python_4.a)  # -> out, a; disabled; same code as python_12

# ---- group: FEET DATA
py_curr_dir_3 = PythonScript(in_name="feet_grid.json")  # -> out, gh_file, gh_dir, out_file; same code as py_curr_dir
current_dir_files_3 = Panel([py_curr_dir_3.gh_file, py_curr_dir_3.gh_dir, py_curr_dir_3.out_file])

# ---- group: EXISTING GRID LOOKUP
panel_16 = Panel("existing_grid_lookup.json")  # disabled
py_curr_dir_4 = PythonScript(in_name=panel_16)  # -> out, gh_file, gh_dir, out_file; disabled; same code as py_curr_dir
current_dir_files_4 = Panel([py_curr_dir_4.gh_file, py_curr_dir_4.gh_dir, py_curr_dir_4.out_file])  # disabled

# ---- group: RBE
py_curr_dir_5 = PythonScript(in_name="rbe.json")  # -> out, gh_file, gh_dir, out_file; same code as py_curr_dir
current_dir_files_5 = Panel([py_curr_dir_5.gh_file, py_curr_dir_5.gh_dir, py_curr_dir_5.out_file])

# ---- group: EXISTING GRID DATA
py_curr_dir_6 = PythonScript(in_name="existing_grid.json")  # -> out, gh_file, gh_dir, out_file; same code as py_curr_dir
current_dir_files_6 = Panel([py_curr_dir_6.gh_file, py_curr_dir_6.gh_dir, py_curr_dir_6.out_file])

py_curr_dir_7 = PythonScript(in_name="setup_points.json")  # -> out, gh_file, gh_dir, out_file; same code as py_curr_dir
current_dir_files_7 = Panel([py_curr_dir_7.gh_file, py_curr_dir_7.gh_dir, py_curr_dir_7.out_file])

panel_17 = Panel("C:\Users\damon\Documents\GitHub\lattice-optimization\test\input\feet_grid.json")
python_14 = PythonScript(path=py_curr_dir_7.out_file, data=python_6.sim_pt_str)  # -> out, a; same code as python_12

# ---- group: FEET DATA
python_15 = PythonScript(path=py_curr_dir_3.out_file, data=python_5.panel_str)  # -> out, a; same code as python_12

# ---- group: EXISTING GRID LOOKUP
python_16 = PythonScript(path=py_curr_dir_4.out_file, data=python_11.lookup)  # -> out, a; disabled; same code as python_12

# ---- group: RBE
python_17 = PythonScript(path=py_curr_dir_5.out_file, data=python_2.rbe_str)  # -> out, a; same code as python_12

# ---- group: EXISTING GRID DATA
python_18 = PythonScript(path=py_curr_dir_6.out_file, data=python_11.coord_list)  # -> out, a; same code as python_12
